# Grasshopper definition TBGEreader.gh (Grasshopper 1.0.7)

# ----
# File Name
number_slider = Slider(-1, range=-1..99)
activate_tbgereader = BooleanToggle(True)
# Readme!
# To work with this program:
# 
# 1. Click on "Reset Address" button to ensure your path in Correct.
# 2. Write name of the file you want to read in the "File Name" panel.
# 3. Double click on "Activate TBGEreader" button to activate main code.
# 4. Your Code is working fine :) Now You can see the plans.
# 5. If "Frame To Show" number slider is equal to -1, you will see ALL frames. You can change it to your desired frame see only one frame.
# 6. Enjoy
# 
# For More Information, Contact me: PedramHashemi75 [at] gmail.com
reset_address = Button(ExpressionNormal="True", ExpressionPressed="False")

address_finder = CSharpScript(Activate=reset_address)  # -> Address; inputs Activate: Boolean
# ---------- address_finder: C# ----------
    if (Activate)    Address = GrasshopperDocument.FilePath;
# ---------- end address_finder ----------
setaddresses = GhPythonScript(Address=address_finder)  # -> CodeAddress, FolderAddress
# ---------- setaddresses: Python ----------
import rhinoscriptsyntax as rs
import ghpythonlib.components as gh

FolderAddress = "\\".join(Address.split("\\")[:-1])
CodeAddress = FolderAddress + "\\ReadTBGE.py"
# ---------- end setaddresses ----------
concat = Concatenate(FragmentA=setaddresses.FolderAddress, FragmentB="\", FragmentC="C1", FragmentD=".TBGE")
file = ReadFile(File=setaddresses.CodeAddress, PerLineParse=False)
file_2 = ReadFile(File=concat, PerLineParse=True)
read_tbge = GhPythonScript(Code=file, Activate=activate_tbgereader, TBGE=file_2, FrameToShow=number_slider)  # -> Out, ShapeOutput, ShapeColorOutput, TextOutput, TextPositionOutput, TextColorOutput
shape_preview = CustomPreview(Geometry=read_tbge.ShapeOutput, Material=read_tbge.ShapeColorOutput)
text_preview = TextTag3D(
    Location=read_tbge.TextPositionOutput,
    Text=read_tbge.TextOutput,
    Size="30",
    Colour=read_tbge.TextColorOutput,
    Justification=5)
